# Grasshopper definition hetal bharwani tree structure hops.gh (Grasshopper 1.0.7)
# plug-ins: Hops

hops = Hops(
    InnerRadius=Slider(43, range=0..50),
    Segments=Slider(17, range=0..30),
    Steps=Slider(9, range=0..10),
    Heights=Slider(20, range=0..40),
    OuterRadius=Slider(0.5, range=0..1),
    CacheResultsInMemory=True,
    CacheSolveResults=True,
    RemoteDefinitionLocation="E:\IAAC\sem 2\data mgmt\assignment 1\tree - hoops.gh",
    RemoteSolveVersion=(0, 1, 0),
    ShowInput_Enabled=False,
    ShowInput_Path=False,
    SynchronousSolve=True)
